# Grasshopper definition generate_curves.gh (Grasshopper 1.0.7)
# plug-ins: Human

pt = ConstructPoint(XCoordinate=0, YCoordinate=0, ZCoordinate=0)
hexgrid = Hexagonal(Plane=PlaneXY(0, 0, 0), Size=1, ExtentX=5, ExtentY=5)  # -> Cells, Points
dist = Distance(PointA=pt, PointB=hexgrid.Points)
bnd = Bounds(Numbers=flatten(dist))
_0_1_0_9 = ConstructDomain(DomainStart=0.1, DomainEnd=0.9)
remap = RemapNumbers(Value=dist, Source=bnd, Target=_0_1_0_9)  # -> Mapped, Clipped
scale = Scale(Geometry=hexgrid.Cells, Center=hexgrid.Points, Factor=remap.Mapped)  # -> Geometry, Transform
bake = BakeGeometry(Bake=Toggle(True), Geometry=scale.Geometry, DeleteOldBakes=False, PreserveTrees=False)
