# Grasshopper definition generate_hatch.gh (Grasshopper 1.0.7)
# plug-ins: Human

number_slider = Slider(51, range=3..100)
_2pi = Pi(Factor=expr("2", 1))
dom = ConstructDomain(DomainStart=0, DomainEnd=_2pi)
dom_2 = ConstructDomain(DomainStart=Slider(4.6, range=1..10), DomainEnd=Slider(5.8, range=1..10))
random = Random(Range=dom, Number=number_slider, Seed=2)
random_2 = Random(Range=dom_2, Number=number_slider, Seed=2)
sort = SortList(Keys=random, ValuesA=random)  # -> Keys, ValuesA
X = UnitX(Factor=1)
Z = UnitZ(Factor=1)
vrot = Rotate(Vector=X, Axis=Z, Angle=sort.ValuesA)
amp = Amplitude(Vector=vrot, Amplitude=random_2)
pt = ConstructPoint(XCoordinate=0, YCoordinate=0, ZCoordinate=0)
move = Move(Geometry=pt, Motion=amp)  # -> Geometry, Transform
intcrv = Interpolate(Vertices=move.Geometry, Degree=3, Periodic=True, KnotStyle=1)  # -> Curve, Length, Domain
crv = Curve(intcrv.Curve)
createhatch = CreateHatch(Bake=Button(), Curves=crv, HatchPatternName="Solid", HatchScale=1, HatchRotation=0)  # -> HatchGeometry, HatchObjects
bake = BakeGeometry(Bake=Toggle(True), Geometry=crv, DeleteOldBakes=False, PreserveTrees=False)
